# Grasshopper definition test.gh (Grasshopper 1.0.8)

radius = GetNumber(Slider(10, range=0..10), AtLeast=1, AtMost=1, Maximum=1.797693135e+308, Minimum=-1.797693135e+308, TreeAccess=False)
height = GetNumber(Slider(10, range=0..10), AtLeast=1, AtMost=1, Maximum=1.797693135e+308, Minimum=-1.797693135e+308, TreeAccess=False)
circle = Circle(Plane=PlaneXY(0, 0, 0), Radius=radius)
unit_z = UnitZ(Factor=height)
extrude = Extrude(Base=circle, Direction=unit_z)
context_bake = ContextBake(Extrusion=extrude)
